# Dynamo graph clear-rooms-and-spaces.dyn "space" (Dynamo 3.2.1.5366)

categories = Categories("OST_MEPSpaces")
all_elements_of_category = ElementsOfCategory(Category=categories)
categories_2 = Categories("OST_Rooms")
all_elements_of_category_2 = ElementsOfCategory(Category=categories_2)
list_create = List.Create(item0=all_elements_of_category, item1=all_elements_of_category_2)
delete = Element.Delete(element=list_create)
