# Dynamo graph iso19650-sheet-naming.dyn "rename sheets" (Dynamo 3.2.1.5366)

# group: Get the sheets
categories = Categories("OST_Sheets")
all_elements_of_category = ElementsOfCategory(Category=categories)

# group: Reading the current sheet parameters
code_block = CodeBlock { "Sheet Name"; }
getParameterValueByName = Element.GetParameterValueByName(element=all_elements_of_category, parameterName=code_block)
code_block_2 = CodeBlock { "Sheet Number"; }
getParameterValueByName_2 = Element.GetParameterValueByName(element=all_elements_of_category, parameterName=code_block_2)

# group: Extracting the numbers with 0 as starting character
code_block_3 = CodeBlock { 1; }
length = String.Length(string=getParameterValueByName_2)
code_block_4 = CodeBlock(Len=length) { Len-1; }
substring = String.Substring(string=getParameterValueByName_2, startIndex=code_block_3, length=code_block_4)
code_block_5 = CodeBlock { 4; "0"; }
padLeft = String.PadLeft(string=substring, newLength=code_block_5.out0, padChars=code_block_5.out1)

# group: Extracting Role
code_block_6 = CodeBlock { 0; 1; }
substring_2 = String.Substring(string=getParameterValueByName_2, startIndex=code_block_6.out0, length=code_block_6.out1)

# group: List Creation of all the elements of the sheet name
code_block_7 = CodeBlock { Originator = "ISPR"; }
count = List.Count(list=padLeft)
ofRepeatedItem = List.OfRepeatedItem(item=code_block_7, amount=count)
code_block_8 = CodeBlock { Volum = "ZZ"; }
ofRepeatedItem_2 = List.OfRepeatedItem(item=code_block_8, amount=count)
code_block_9 = CodeBlock { Lvl = "01"; }
ofRepeatedItem_3 = List.OfRepeatedItem(item=code_block_9, amount=count)
code_block_10 = CodeBlock { Type = "DR"; }
ofRepeatedItem_4 = List.OfRepeatedItem(item=code_block_10, amount=count)
list_create = List.Create(item0=ofRepeatedItem, item1=ofRepeatedItem_2, item2=ofRepeatedItem_3, item3=ofRepeatedItem_4, item4=substring_2, item5=padLeft)
transpose = List.Transpose(lists=list_create)

# group: Sheets Renamed
code_block_11 = CodeBlock { "_"; }
join = String.Join(separator=code_block_11, string0=transpose)

# group: Writting back to Revit
code_block_12 = CodeBlock { "Sheet Number"; }
python_script = Python(IN[0]=transpose)  # IronPython2
# ---------- python_script.python (10 lines) ----------
data = IN[0]  # list of lists

result = []
for row in data:
    try:
        result.append("-".join([str(x) for x in row]))
    except:
        result.append("")  # if any bad row, keep safe

OUT = result
# ----------------------------------------
setParameterByName = Element.SetParameterByName(element=all_elements_of_category, parameterName=code_block_12, value=python_script)
